# Grasshopper definition Columns_GH.gh (Grasshopper 1.0.7)

rh_in_y = Slider(50, range=0..100)
rh_in_x = Slider(25, range=0..100)
rectangle = Rectangle(Plane=PlaneXY(0, 0, 0), XSize=rh_in_x, YSize=rh_in_y, Radius=0)  # -> Rectangle, Length
divide_surface = DivideSurface(Surface=rectangle.Rectangle, UCount=Slider(10, range=5..50), VCount=Slider(20, range=5..50))  # -> Points, Normals, Parameters

# ---- group: RH_IN: Columns radius
number_slider = Slider(0.15, range=0..0.2)

# ----
circle = Circle(Plane=divide_surface.Points, Radius=number_slider)
list_length = ListLength(List=circle)
range = Range(Domain=Domain(0, 1), Steps=expr("x-1", list_length))

# ---- group: RH_IN:Heigth
rotation = Slider(1, range=1..20)

# ----
graph_mapper = GraphMapper(range, x0=0, x1=1, y0=0, y1=1, Ox=0.5, Oy=0, Px=0.75, Py=0.25, container_name="Parabola")
construct_domain = ConstructDomain(DomainStart="0.1", DomainEnd=rotation)
bounds = Bounds(Numbers=graph_mapper)
remap_numbers = RemapNumbers(Value=graph_mapper, Source=bounds, Target=construct_domain)  # -> Mapped, Clipped
unit_z = UnitZ(Factor=remap_numbers.Mapped)
extrude = Extrude(Base=circle, Direction=unit_z)
xy_plane = XYPlane(Origin=Point(0, 0, 0))
cap_holes = CapHoles(Brep=extrude)
mirror = Mirror(Geometry=cap_holes, Plane=xy_plane)  # -> Geometry, Transform

# ---- group: RH_OUT:mesh
mesh = Mesh([mirror.Geometry, cap_holes])

# ----
custom_preview = CustomPreview(Geometry=mesh, Material=ColourSwatch(SwatchColor=RGB(180, 250, 255)))
