# Grasshopper definition GH_final_tower_solar studies.gh (Grasshopper 1.0.7)

# ---- group: LOCATION AND SIZE
vector_xyz = VectorXYZ(XComponent=Slider(-43, range=-50..21), YComponent=Slider(-31, range=-40..21), ZComponent=Slider(2, range=-40..21))  # -> Vector, Length
rectangle = Rectangle(Plane=PlaneXY(0, 0, 0), XSize="20", YSize="20", Radius=0)  # -> Rectangle, Length
move = Move(Geometry=rectangle.Rectangle, Motion=vector_xyz.Vector)  # -> Geometry, Transform
rotate = Rotate(Geometry=move.Geometry, Angle=degrees(Slider(64.875, range=0..100)), Plane=PlaneXY(0, 0, 0))  # -> Geometry, Transform

# ---- group: RH_IN:count
number_of_floors = Slider(17, range=5..20)

# ---- group: RH_IN:height
floor_height = Slider(3.5, range=3..4.5)

# ---- group: RH_IN:roofsize
number_slider = Slider(0.5, range=0.4..0.8)

# ---- group: RH_IN:roofshape
number_slider_2 = Slider(10, range=3..10)

# ----
vector_xyz_2 = VectorXYZ(XComponent=Slider(-20, range=-20..10), YComponent=Slider(-5, range=-10..10), ZComponent=Slider(0.116, range=0..10))  # -> Vector, Length
xy_plane = XYPlane(Origin=vector_xyz_2.Vector)
rotate_2 = Rotate(Geometry=xy_plane, Angle=degrees(Slider(157, range=0..180)), Plane=PlaneXY(0, 0, 0))  # -> Geometry, Transform
ellipse = Ellipse(Plane=rotate_2.Geometry, Radius1=Slider(25, range=0..40), Radius2=Slider(20, range=0..20))  # -> Ellipse, Focus1, Focus2
area = Area(Geometry=ellipse.Ellipse)  # -> Area, Centroid
number_slider_3 = Slider(6, range=6..18)
scale = Scale(Geometry=ellipse.Ellipse, Center=area.Centroid, Factor=number_slider)  # -> Geometry, Transform
pi = Pi(Factor="4")
subtraction = Subtraction(A=number_slider_2, B="1")
pi_2 = Pi(Factor="4")
subtraction_2 = Subtraction(A=number_slider_3, B="1")
range = Range(Domain=pi, Steps=subtraction)
range_2 = Range(Domain=pi_2, Steps=subtraction_2)
divide_curve = DivideCurve(Curve=scale.Geometry, Count=number_slider_3, Kinks=False)  # -> Points, Tangents, Parameters
cosine = Cosine(Value=range)
cosine_2 = Cosine(Value=range_2)
divide_curve_2 = DivideCurve(Curve=ellipse.Ellipse, Count=number_slider_2, Kinks=False)  # -> Points, Tangents, Parameters
multiplication = Multiplication(A=cosine, B=Slider(4, range=0..100))
multiplication_2 = Multiplication(A=cosine_2, B=Slider(5, range=0..100))
unit_z = UnitZ(Factor=multiplication)
unit_z_2 = UnitZ(Factor=multiplication_2)
move_2 = Move(Geometry=divide_curve.Points, Motion=unit_z_2)  # -> Geometry, Transform
move_3 = Move(Geometry=divide_curve_2.Points, Motion=unit_z)  # -> Geometry, Transform
number_slider_4 = Slider(50, range=0..100)
interpolate = Interpolate(Vertices=move_3.Geometry, Degree=3, Periodic=invert(False), KnotStyle=1)  # -> Curve, Length, Domain
interpolate_2 = Interpolate(Vertices=move_2.Geometry, Degree=3, Periodic=invert(False), KnotStyle=1)  # -> Curve, Length, Domain
divide_curve_3 = DivideCurve(Curve=interpolate_2.Curve, Count=number_slider_4, Kinks=False)  # -> Points, Tangents, Parameters
divide_curve_4 = DivideCurve(Curve=interpolate.Curve, Count=number_slider_4, Kinks=False)  # -> Points, Tangents, Parameters
line = Line(StartPoint=divide_curve_3.Points, EndPoint=divide_curve_4.Points)
loft = Loft(Curves=line, Options={Adjust=True, Closed=True, LoftEnds=0, LoftSimp=0, LoftType=0, Rebuild=10, Refit=0.01})
number_slider_5 = Slider(0.2, range=0..1)
unit_z_3 = UnitZ(Factor=number_slider_5)
extrude = Extrude(Base=loft, Direction=unit_z_3)
unit_z_4 = UnitZ(Factor=Slider(5.8, range=0..10))
move_4 = Move(Geometry=[interpolate_2.Curve, interpolate.Curve, line], Motion=unit_z_4)  # -> Geometry, Transform
move_5 = Move(Geometry=extrude, Motion=unit_z_4)  # -> Geometry, Transform

# ---- group: RH_IN:rotation
rotation = Slider(81, range=0..90)

# ----
area_2 = Area(Geometry=loft)  # -> flatten(Area), Centroid; disabled
mass_addition = MassAddition(Input=area_2.Area)  # -> Result, PartialResults; disabled

# ---- group: RH_IN:roofarea
integer = Integer(mass_addition.Result)  # disabled

# ----
unit_z_5 = UnitZ(Factor=number_slider_5)
panel = Panel(integer)  # disabled
move_6 = Move(Geometry=move_4.Geometry, Motion=unit_z_5)  # -> Geometry, Transform

# ---- group: RH_OUT:edges1
curve = Curve(move_6.Geometry)

# ---- group: RH_OUT:mesh1
mesh = Mesh(move_5.Geometry)

# ----
preview = CustomPreview(Geometry=curve, Material=ColourSwatch(SwatchColor=RGB(0, 0, 0)))
preview_2 = CustomPreview(Geometry=mesh, Material=ColourSwatch(SwatchColor=RGB(174, 248, 255)))

# ----
# Import Location from EPW File
panel_2 = Panel("https://www.energyplus.net/weather-download/europe_wmo_region_6/NOR//NOR_Oslo.Fornebu.014880_IWEC/all")
downloadepw = LBDownloadWeather(weather_URL=panel_2)  # -> epw_file, stat_file, ddy_file; plug-in component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
importloc = LBImportLocation(epw_file=downloadepw.epw_file)  # -> location; plug-in component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

list = ValueList({"January": 1, "February": 2, "March": 3, "April": 4, "May": 5, "June": 6, "July": 7, "August": 8, "September": 9, "October": 10, "November": 11, "December": 12}, selected="February")
list_2 = ValueList({"1", "8", "15", "21"}, selected="21")

# ---- group: RH_IN:day
int = Integer(list_2)

# ---- group: RH_IN:month
int_2 = Integer(list)

# ----
# Analysis Period for
# Summer Solstice
panel_3 = Panel("4")
analysisperiod = LBAnalysisPeriod(start_month=int_2, start_day=int, start_hour=0, end_month=int_2, end_day=int, timestep=panel_3)  # -> period, hoys, dates; plug-in component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

# ---- group: RH_OUT:Mesh4
mesh_2 = Mesh([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])

# ---- group: SITE
surface = Surface(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)

# ----
custom_preview = CustomPreview(Geometry=mesh_2, Material=ColourSwatch(SwatchColor=RGB(112, 112, 112)))

# ----
# Create Sunpath
sunpath = LBSunPath(location=importloc, hoys=analysisperiod.hoys, scale=1)  # -> report, vectors, altitudes, azimuths, hoys, sun_pts, analemma, daily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; plug-in component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

# ---- group: Run Me!
toggle = BooleanToggle(True)

# ---- group: RH_IN:sunstudy
bool = Boolean(False)

# ----
series = Series(Start=0, Step=floor_height, Count=number_of_floors)
unit_z_6 = UnitZ(Factor=series)
move_7 = Move(Geometry=rotate.Geometry, Motion=unit_z_6)  # -> Geometry, Transform
list_length = ListLength(List=move_7.Geometry)
range_3 = Range(Domain=Domain(0, 1), Steps=expr("x-1", list_length))
graph_mapper = GraphMapper(
    range_3,
    x0=0,
    x1=1,
    y0=0,
    y1=1,
    container_name="Bezier",
    cpx=[0, 0.8283590674, 0.1689217389, 1],
    cpy=[0, 0.1796525717, 0.7616137266, 1])
area_3 = Area(Geometry=move_7.Geometry)  # -> Area, Centroid
construct_domain = ConstructDomain(DomainStart=Slider(0, range=0..100), DomainEnd=rotation)
bounds = Bounds(Numbers=graph_mapper)
remap_numbers = RemapNumbers(Value=graph_mapper, Source=bounds, Target=construct_domain)  # -> Mapped, Clipped
rotate_3 = Rotate(Geometry=move_7.Geometry, Angle=degrees(remap_numbers.Mapped), Plane=area_3.Centroid)  # -> Geometry, Transform
scale_bottom = Slider(1, range=0.5..1)

# ---- group: SCALE TOP/BOTTOM
list_length_2 = ListLength(List=rotate_3.Geometry)
area_4 = Area(Geometry=rotate_3.Geometry)  # -> Area, Centroid
range_4 = Range(Domain=Domain(0, 1), Steps=expr("x-1", list_length_2))
scale_top = Slider(0.75, range=0.5..1)
graph_mapper_2 = GraphMapper(range_4, x0=0, x1=1, y0=0, y1=1, container_name="Sine", Equation_px=[0.501973331, 1], Equation_py=[0.01055246592, 1])
remap = Remap(data=graph_mapper_2, min=scale_bottom, max=scale_top)

# ----
scale_2 = Scale(Geometry=rotate_3.Geometry, Center=area_4.Centroid, Factor=remap)  # -> Geometry, Transform
loft_2 = Loft(
    Curves=scale_2.Geometry,
    Options={Adjust=False, Closed=False, LoftEnds=0, LoftSimp=0, LoftType=0, Rebuild=10, Refit=0.01})
cap_holes = CapHoles(Brep=loft_2)
mesh_brep = MeshBrep(
    Brep=cap_holes,
    Settings={GridMaxCount=0, GridMinCount=16, JaggedSeams=False, MaxEdgeLength=0, MinEdgeLength=0.0001, MinTolerance=0, Refine=True, RefineAngle=0, RelativeTolerance=0.65, SimplePlanes=True, Tolerance=0})
preview_3 = CustomPreview(Geometry=mesh_brep, Material=ColourSwatch(SwatchColor=RGB(174, 248, 255)))

area_5 = Area(Geometry=scale_2.Geometry)  # -> flatten(Area), Centroid; disabled
mass_addition_2 = MassAddition(Input=area_5.Area)  # -> Result, PartialResults; disabled

# ---- group: RH_IN:towerarea
integer_2 = Integer(mass_addition_2.Result)  # disabled

# ---- group: RH_OUT:edges
curve_2 = Curve(scale_2.Geometry)

# ----
panel_4 = Panel(integer_2)  # disabled
preview_4 = CustomPreview(Geometry=curve_2, Material=ColourSwatch(SwatchColor=RGB(0, 0, 0)))

# ---- group: RH_OUT:mesh
mesh_3 = Mesh(mesh_brep)

# ----
geo = Geometry(mesh_3)
geo_2 = Geometry(mesh)

# ----
# Run Direct Sun Study
panel_5 = Panel("2")
directsunhours = LBDirectSunHours(
    vectors=flatten(sunpath.vectors),
    timestep=panel_3,
    geometry=flatten([surface, mesh_2]),
    context=flatten([geo_2, geo]),
    grid_size=panel_5,
    offset_dist="1",
    run=toggle)  # -> report, points, results, mesh, legend, title, int_mtx; plug-in component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

filter = StreamFilter(Gate=bool, Stream0=directsunhours.mesh, Stream1=surface)
dispatch = Dispatch(List=filter, DispatchPattern=bool)  # -> ListA, ListB

# ---- group: RH_OUT:mesh3
mesh_4 = Mesh(dispatch.ListA)

# ---- group: RH_OUT:mesh2
mesh_5 = Mesh(dispatch.ListB)

# ----
custom_preview_2 = CustomPreview(Geometry=mesh_4, Material=ColourSwatch(SwatchColor=RGB(174, 248, 255)))

# ==== cluster Remap: Remaps numbers
data = ClusterInput()
min = ClusterInput()
max = ClusterInput()
bnd = Bounds(Numbers=data)
dom = ConstructDomain(DomainStart=min, DomainEnd=max)
remap = RemapNumbers(Value=data, Source=bnd, Target=dom)  # -> Mapped, Clipped
R = ClusterOutput(remap.Mapped)
