# Grasshopper definition GH_tower_Embedded model.gh (Grasshopper 1.0.7)

vector_xyz = VectorXYZ(XComponent=Slider(-15, range=-20..10), YComponent=Slider(-4, range=-10..10), ZComponent=Slider(0, range=0..10))  # -> Vector, Length
xy_plane = XYPlane(Origin=vector_xyz.Vector)
rotate = Rotate(Geometry=xy_plane, Angle=degrees(Slider(157, range=0..180)), Plane=PlaneXY(0, 0, 0))  # -> Geometry, Transform
ellipse = Ellipse(Plane=rotate.Geometry, Radius1=Slider(30, range=0..40), Radius2=Slider(20, range=0..20))  # -> Ellipse, Focus1, Focus2
area = Area(Geometry=ellipse.Ellipse)  # -> Area, Centroid
number_slider = Slider(18, range=6..18)
number_slider_2 = Slider(6, range=6..18)
scale = Scale(Geometry=ellipse.Ellipse, Center=area.Centroid, Factor=Slider(0.5, range=0.4..0.8))  # -> Geometry, Transform
pi = Pi(Factor="4")
subtraction = Subtraction(A=number_slider, B="1")
pi_2 = Pi(Factor="4")
subtraction_2 = Subtraction(A=number_slider_2, B="1")
range = Range(Domain=pi, Steps=subtraction)
range_2 = Range(Domain=pi_2, Steps=subtraction_2)
divide_curve = DivideCurve(Curve=scale.Geometry, Count=number_slider_2, Kinks=False)  # -> Points, Tangents, Parameters
cosine = Cosine(Value=range)
cosine_2 = Cosine(Value=range_2)
divide_curve_2 = DivideCurve(Curve=ellipse.Ellipse, Count=number_slider, Kinks=False)  # -> Points, Tangents, Parameters
multiplication = Multiplication(A=cosine, B=Slider(3, range=0..100))
multiplication_2 = Multiplication(A=cosine_2, B=Slider(5, range=0..100))
unit_z = UnitZ(Factor=multiplication)
unit_z_2 = UnitZ(Factor=multiplication_2)
move = Move(Geometry=divide_curve.Points, Motion=unit_z_2)  # -> Geometry, Transform
move_2 = Move(Geometry=divide_curve_2.Points, Motion=unit_z)  # -> Geometry, Transform
number_slider_3 = Slider(50, range=0..100)
interpolate = Interpolate(Vertices=move.Geometry, Degree=3, Periodic=invert(False), KnotStyle=1)  # -> Curve, Length, Domain
interpolate_2 = Interpolate(Vertices=move_2.Geometry, Degree=3, Periodic=invert(False), KnotStyle=1)  # -> Curve, Length, Domain
divide_curve_3 = DivideCurve(Curve=interpolate.Curve, Count=number_slider_3, Kinks=False)  # -> Points, Tangents, Parameters
divide_curve_4 = DivideCurve(Curve=interpolate_2.Curve, Count=number_slider_3, Kinks=False)  # -> Points, Tangents, Parameters
line = Line(StartPoint=divide_curve_3.Points, EndPoint=divide_curve_4.Points)
loft = Loft(Curves=line, Options={Adjust=True, Closed=True, LoftEnds=0, LoftSimp=0, LoftType=0, Rebuild=10, Refit=0.01})
unit_z_3 = UnitZ(Factor=Slider(0.4, range=0..1))
extrude = Extrude(Base=loft, Direction=unit_z_3)
unit_z_4 = UnitZ(Factor=Slider(5.6, range=0..10))
move_3 = Move(Geometry=[interpolate.Curve, interpolate_2.Curve, line], Motion=unit_z_4)  # -> Geometry, Transform
move_4 = Move(Geometry=extrude, Motion=unit_z_4)  # -> Geometry, Transform
curve = Curve(move_3.Geometry)

# ---- group: RH_IN:count
number_of_floors = Slider(10, range=8..20)

# ---- group: RH_IN:height
floor_height = Slider(3.5, range=3..4.5)

# ---- group: RH_IN:rotation
rotation = Slider(0, range=0..90)

# ----
preview = CustomPreview(Geometry=curve, Material=ColourSwatch(SwatchColor=RGB(0, 0, 0)))
preview_2 = CustomPreview(Geometry=move_4.Geometry, Material=ColourSwatch(SwatchColor=RGB(174, 248, 255)))

# ----
# Import Location from EPW File
panel = Panel("https://www.energyplus.net/weather-download/europe_wmo_region_6/NOR//NOR_Oslo.Fornebu.014880_IWEC/all")
downloadepw = LBDownloadWeather(weather_URL=panel)  # -> epw_file, stat_file, ddy_file; plug-in component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
importloc = LBImportLocation(epw_file=downloadepw.epw_file)  # -> location; plug-in component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

downloadepw_2 = Ladybug_downloadEPWWeatherFile(download=Toggle(True))  # -> Output; plug-in component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

# ---- group: RH_IN:move_x
number_slider_4 = Slider(4, range=1..10)  # disabled

# ---- group: RH_IN:move_y
# Make "context" dynamic to make
# Rhino.Compute example more interesting!
number_slider_5 = Slider(6, range=1..10)  # disabled

# ---- group: RH_IN:height
number_slider_6 = Slider(1, range=1..10)  # disabled

# ----
# Analysis Period for
# Summer Solstice
panel_2 = Panel("6")
analysisperiod = LBAnalysisPeriod(start_month=panel_2, start_day="21", start_hour=0, end_month=panel_2, end_day="21", timestep="4")  # -> period, hoys, dates; plug-in component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

mesh = Mesh(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)
mesh_2 = Mesh([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])
brep = Brep(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)  # disabled
scale_nu = ScaleNU(Geometry=brep, Plane=PlaneXY(0, 0, 0), ScaleX=1, ScaleY=1, ScaleZ=number_slider_6)  # -> Geometry, Transform; disabled
vec = VectorXYZ(XComponent=number_slider_4, YComponent=number_slider_5, ZComponent=0)  # -> Vector, Length; disabled
custom_preview = CustomPreview(Geometry=[mesh_2, mesh], Material=ColourSwatch(SwatchColor=RGB(255, 255, 255)))
merge = Merge(Data1=mesh_2, Data2=mesh)
move_5 = Move(Geometry=scale_nu.Geometry, Motion=vec.Vector)  # -> Geometry, Transform; disabled

# ----
# Create Sunpath
panel_3 = Panel("20")
sunpath = LBSunPath(north=panel_3, location=importloc, hoys=analysisperiod.hoys, scale=1)  # -> report, vectors, altitudes, azimuths, hoys, sun_pts, analemma, daily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; plug-in component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

# ---- group: Run Me!
toggle = BooleanToggle(True)

# ----
vector_xyz_2 = VectorXYZ(XComponent=Slider(-50, range=-50..21), YComponent=Slider(-32, range=-40..21), ZComponent=Slider(2, range=-40..21))  # -> Vector, Length
rectangle = Rectangle(Plane=PlaneXY(0, 0, 0), XSize="25", YSize="25", Radius=0)  # -> Rectangle, Length
move_6 = Move(Geometry=rectangle.Rectangle, Motion=vector_xyz_2.Vector)  # -> Geometry, Transform
rotate_2 = Rotate(Geometry=move_6.Geometry, Angle=degrees(Slider(64.875, range=0..100)), Plane=PlaneXY(0, 0, 0))  # -> Geometry, Transform
series = Series(Start=0, Step=floor_height, Count=number_of_floors)
unit_z_5 = UnitZ(Factor=series)
move_7 = Move(Geometry=rotate_2.Geometry, Motion=unit_z_5)  # -> Geometry, Transform
list_length = ListLength(List=move_7.Geometry)
range_3 = Range(Domain=Domain(0, 1), Steps=expr("x-1", list_length))
graph_mapper = GraphMapper(
    range_3,
    x0=0,
    x1=1,
    y0=0,
    y1=1,
    container_name="Bezier",
    cpx=[0, 0.8283590674, 0.1689217389, 1],
    cpy=[0, 0.1796525717, 0.7616137266, 1])
area_2 = Area(Geometry=move_7.Geometry)  # -> Area, Centroid
construct_domain = ConstructDomain(DomainStart=Slider(0, range=0..100), DomainEnd=rotation)
bounds = Bounds(Numbers=graph_mapper)
remap_numbers = RemapNumbers(Value=graph_mapper, Source=bounds, Target=construct_domain)  # -> Mapped, Clipped
rotate_3 = Rotate(Geometry=move_7.Geometry, Angle=degrees(remap_numbers.Mapped), Plane=area_2.Centroid)  # -> Geometry, Transform
scale_bottom = Slider(1, range=0.5..1)

# ---- group: SCALE TOP/BOTTOM
area_3 = Area(Geometry=rotate_3.Geometry)  # -> Area, Centroid
list_length_2 = ListLength(List=rotate_3.Geometry)
range_4 = Range(Domain=Domain(0, 1), Steps=expr("x-1", list_length_2))
scale_top = Slider(1, range=0.5..1)
graph_mapper_2 = GraphMapper(range_4, x0=0, x1=1, y0=0, y1=1, container_name="Bezier", cpx=[0, 0.5365840793, 0.4105822444, 1], cpy=[0, 0, 1, 1])
remap = Remap(data=graph_mapper_2, min=scale_bottom, max=scale_top)

# ----
scale_2 = Scale(Geometry=rotate_3.Geometry, Center=area_3.Centroid, Factor=remap)  # -> Geometry, Transform
loft_2 = Loft(
    Curves=scale_2.Geometry,
    Options={Adjust=False, Closed=False, LoftEnds=0, LoftSimp=0, LoftType=0, Rebuild=10, Refit=0.01})
cap_holes = CapHoles(Brep=loft_2)
mesh_brep = MeshBrep(
    Brep=cap_holes,
    Settings={GridMaxCount=0, GridMinCount=16, JaggedSeams=False, MaxEdgeLength=0, MinEdgeLength=0.0001, MinTolerance=0, Refine=True, RefineAngle=0, RelativeTolerance=0.65, SimplePlanes=True, Tolerance=0})
preview_3 = CustomPreview(Geometry=mesh_brep, Material=ColourSwatch(SwatchColor=RGB(174, 248, 255)))

# ---- group: RH_OUT:edges
curve_2 = Curve(scale_2.Geometry)

# ----
preview_4 = CustomPreview(Geometry=curve_2, Material=ColourSwatch(SwatchColor=RGB(0, 0, 0)))

# ---- group: RH_OUT:mesh
mesh_3 = Mesh(mesh_brep)

# ----
# Run Direct Sun Study
geo = Geometry(mesh_3)
geo_2 = Geometry(move_4.Geometry)
directsunhours = LBDirectSunHours(
    vectors=flatten(sunpath.vectors),
    timestep="4",
    geometry=flatten([geo_2, geo]),
    context=flatten(merge),
    grid_size="1",
    offset_dist="0.1",
    run=toggle)  # -> report, points, results, mesh, legend, title, int_mtx; plug-in component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

# ---- group: RH_OUT:mesh
mesh_4 = Mesh(directsunhours.mesh)

# ==== cluster Remap: Remaps numbers
data = ClusterInput()
min = ClusterInput()
max = ClusterInput()
bnd = Bounds(Numbers=data)
dom = ConstructDomain(DomainStart=min, DomainEnd=max)
remap = RemapNumbers(Value=data, Source=bnd, Target=dom)  # -> Mapped, Clipped
R = ClusterOutput(remap.Mapped)
