# Grasshopper definition GH_tower_adv.gh (Grasshopper 1.0.7)

mesh_brep = MeshBrep(
    Brep=[<geometry referenced from the Rhino model> x3],
    Settings={GridMaxCount=0, GridMinCount=16, JaggedSeams=False, MaxEdgeLength=0, MinEdgeLength=0.0001, MinTolerance=0, Refine=True, RefineAngle=0, RelativeTolerance=0.65, SimplePlanes=True, Tolerance=0})

# ---- group: CONTEXT
mesh = Mesh([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])

# ---- group: SITE
mesh_2 = Mesh(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)

# ----
area = Area(Geometry=mesh_2)  # -> Area, Centroid

# ---- group: RH_OUT:context
mesh_3 = Mesh([mesh, mesh_2, mesh_brep])

# ----
preview = CustomPreview(Geometry=mesh_3, Material=ColourSwatch(SwatchColor=RGB(255, 255, 255)))

# ---- group: TOWER / RH_IN:count
number_of_floors = Slider(25, range=5..25)

# ---- group: TOWER / RH_IN:height
floor_height = Slider(3.1, range=3..4.5)

# ---- group: TOWER
number_slider = Slider(-10, range=-10..10)
vector_xyz = VectorXYZ(XComponent=number_slider, YComponent=number_slider, ZComponent=0)  # -> Vector, Length
rectangle = Rectangle(Plane=area.Centroid, XSize="20", YSize="20", Radius=0)  # -> Rectangle, Length
move = Move(Geometry=rectangle.Rectangle, Motion=vector_xyz.Vector)  # -> Geometry, Transform
rotate = Rotate(Geometry=move.Geometry, Angle=degrees(Slider(63.245, range=0..100)), Plane=area.Centroid)  # -> Geometry, Transform
series = Series(Start=0, Step=floor_height, Count=number_of_floors)
unit_z = UnitZ(Factor=series)
move_2 = Move(Geometry=rotate.Geometry, Motion=unit_z)  # -> Geometry, Transform

# ---- group: TWIST / RH_IN:rotation
rotation = Slider(0, range=0..45)

# ---- group: RH_IN:scale
scale_bottom = Slider(1, range=0.5..1)

# ---- group: TWIST
list_length = ListLength(List=move_2.Geometry)
area_2 = Area(Geometry=move_2.Geometry)  # -> Area, Centroid
range = Range(Domain=Domain(0, 1), Steps=expr("x-1", list_length))
graph_mapper = GraphMapper(
    range,
    x0=0,
    x1=1,
    y0=0,
    y1=1,
    container_name="Bezier",
    cpx=[0, 0.6745499372, 0.5593686104, 1],
    cpy=[0, 0.1718997955, 0.8211015463, 1])
panel = Panel("0")

# ----
remap = Remap(data=graph_mapper, min=panel, max=rotation)

# ---- group: TWIST (continued)
rotate_2 = Rotate(Geometry=move_2.Geometry, Angle=degrees(remap), Plane=area_2.Centroid)  # -> Geometry, Transform

# ---- group: SCALE TOP/BOTTOM
area_3 = Area(Geometry=rotate_2.Geometry)  # -> Area, Centroid
list_length_2 = ListLength(List=rotate_2.Geometry)
range_2 = Range(Domain=Domain(0, 1), Steps=expr("x-1", list_length_2))
scale_top = Slider(1, range=0.5..1)
graph_mapper_2 = GraphMapper(
    range_2,
    x0=0,
    x1=1,
    y0=0,
    y1=1,
    container_name="Bezier",
    cpx=[0, 0.5989863873, 0.3766854107, 1],
    cpy=[0, 0, 0.9996798038, 1])
remap_2 = Remap(data=graph_mapper_2, min=scale_bottom, max="1")

# ----
scale = Scale(Geometry=rotate_2.Geometry, Center=area_3.Centroid, Factor=remap_2)  # -> Geometry, Transform
loft = Loft(Curves=scale.Geometry, Options={Adjust=False, Closed=False, LoftEnds=0, LoftSimp=0, LoftType=0, Rebuild=10, Refit=0.01})
preview_2 = CustomPreview(Geometry=scale.Geometry, Material=ColourSwatch(SwatchColor=RGB(0, 0, 0)))
cap_holes = CapHoles(Brep=loft)
mesh_brep_2 = MeshBrep(
    Brep=cap_holes,
    Settings={GridMaxCount=0, GridMinCount=16, JaggedSeams=False, MaxEdgeLength=0, MinEdgeLength=0.0001, MinTolerance=0, Refine=True, RefineAngle=0, RelativeTolerance=0.65, SimplePlanes=True, Tolerance=0})

# ---- group: RH_OUT:mesh
mesh_4 = Mesh(mesh_brep_2)

# ---- group: RH_OUT:edge
curve = Curve(scale.Geometry)

# ----
preview_3 = CustomPreview(Geometry=mesh_4, Material=ColourSwatch(SwatchColor=RGB(255, 255, 255)))

# ==== cluster Remap: Remaps numbers
data = ClusterInput()
min = ClusterInput()
max = ClusterInput()
bnd = Bounds(Numbers=data)
dom = ConstructDomain(DomainStart=min, DomainEnd=max)
remap = RemapNumbers(Value=data, Source=bnd, Target=dom)  # -> Mapped, Clipped
R = ClusterOutput(remap.Mapped)
